# Grasshopper definition Bella_A2_.gh (Grasshopper 0.9.80)

number_slider = Slider(1, range=0..1)
number = Number()
circle_3pt = Circle3Pt(PointA=number)  # -> Circle, Plane, Radius
circle = Circle({Plane=Plane(origin=(-11, 30, 0), x=(0.8762159087, 0.4819187498, 0), y=(-0.4819187498, 0.8762159087, 0)), Radius=11.41271221})
rectangle = Rectangle(Plane=PlaneXY(0, 0, 0), XSize=Slider(11, range=0..30), YSize=Slider(13, range=0..30), Radius=0)  # -> Rectangle, Length
vector_xyz = VectorXYZ(XComponent=0, YComponent=0, ZComponent=0)  # -> Vector, Length
move = Move(Geometry=rectangle.Rectangle, Motion=vector_xyz.Vector)  # -> Geometry, Transform
move_2 = Move(Motion=Vector(0, 0, 10))  # -> Geometry, Transform
trim_with_regions = TrimWithRegions()  # -> Inside, Outside
polar_array = PolarArray(Geometry=move.Geometry, Plane=PlaneXY(0, 0, 0), Count=10, Angle=6.283185307)  # -> Geometry, Transform
