# Grasshopper definition Bella_A2_Grasshopper.gh (Grasshopper 0.9.80)

number_slider = Slider(0.75, range=0..1)
number_slider_2 = Slider(0.13, range=0..5)
number_slider_3 = Slider(0.2, range=0..1)
subtraction = Subtraction(A=number_slider, B=number_slider_3)
rectangle = Rectangle(Plane=PlaneXY(0, 0, 0), XSize=Slider(5, range=0..5), YSize=number_slider, Radius=0)  # -> Rectangle, Length
rectangle_2 = Rectangle(Plane=PlaneXY(0, 0, 0), XSize=number_slider_2, YSize=number_slider_3, Radius=0)  # -> Rectangle, Length
vector_xyz = VectorXYZ(XComponent=number_slider_2, YComponent=subtraction, ZComponent=0)  # -> Vector, Length
vector_xyz_2 = VectorXYZ(XComponent=number_slider_2, YComponent=0, ZComponent=0)  # -> Vector, Length
move = Move(Geometry=rectangle_2.Rectangle, Motion=vector_xyz_2.Vector)  # -> Geometry, Transform
move_2 = Move(Geometry=rectangle_2.Rectangle, Motion=vector_xyz.Vector)  # -> Geometry, Transform
rotate = Rotate(Geometry=rectangle_2.Rectangle, Angle=1.570796327, Plane=PlaneXY(0, 0, 0))  # -> Geometry, Transform
unit_x = UnitX(Factor=Slider(0.5, range=0..1))
unit_x_2 = UnitX(Factor=Slider(0.5, range=0..1))
vector_xyz_3 = VectorXYZ(XComponent=0.5, YComponent=0.3, ZComponent=0)  # -> Vector, Length
move_3 = Move(Geometry=rotate.Geometry, Motion=vector_xyz_3.Vector)  # -> Geometry, Transform
unit_x_3 = UnitX(Factor=Slider(1, range=0..1))
linear_array = LinearArray(Geometry=move.Geometry, Direction=unit_x, Count=Slider(10, range=0..10))  # -> Geometry, Transform
linear_array_2 = LinearArray(Geometry=move_2.Geometry, Direction=unit_x_2, Count=Slider(10, range=0..10))  # -> Geometry, Transform
linear_array_3 = LinearArray(Geometry=move_3.Geometry, Direction=unit_x_3, Count=5)  # -> Geometry, Transform
region_difference = RegionDifference(CurvesA=rectangle.Rectangle, CurvesB=linear_array.Geometry)
region_difference_2 = RegionDifference(CurvesA=region_difference, CurvesB=linear_array_2.Geometry)
region_difference_3 = RegionDifference(CurvesA=region_difference_2, CurvesB=linear_array_3.Geometry)
